vi "PackageDetails.gviweb"   [LabVIEW NXG Preview 4.0.0]
panel controls:
  "Download": bool
  "Version": i32
panel indicators:
  "URL Image": string
  "Name": string
  "PkgIcon": string
  "ReleaseDate": string
  "Vendor": string
  "Author": string
  "Description": string
  "Release Notes": string
  "Dependencies": string
  "PrototypedBy": string
types:
  "Package Version.gtype" = cluster{"ReleaseDate": string, "Version": string, "Name": string, "DisplayName": string, "Description": string, "Vendor": string, "Author": string, "Release Notes": string, "Dependencies": string[], "IconURL": string, "PackageURL": string}
  T1 = cluster{"BaseURL": string, "Package Details": "Package Version.gtype", "All Versions": string[]}
uses:
  QMH support::Message Queue::Create All Message Queues.gviweb
  HTTP Client API::Base URL--constant.gvi
  QMH support::Message Queue::Dequeue Message.gviweb
  QMH support::Message Queue::Enqueue Message (Single).gviweb
  BusyStateAPI::BusyStateAPI.jsli::SetBusy
  HTTP Client API::Connection::Open Connection.gvi
  HTTP Client API::Packages::Get Package Details.gvi
  HTTP Client API::Packages::Get All Package Versions.gvi
  HTTP Client API::Connection::Close Connection.gvi
  BusyStateAPI::BusyStateAPI.jsli::UnsetBusy
  WebApp::Support::JSON Timestamp to Display.gvi
  WebApp::Support::Join Strings.gvi
  HTTP Client API::Packages::Set Package.gvi
  RedirectURL::Redirect.jsli::Redirect
  NI::G Core::Error::Read Error Code.gvi
  Error Handling::Error Handler.gvi
  NI::G Core::Error::Build Error Cluster.gvi
  QMH support::Error Handler - Message Handling Loop.gviweb
  QMH support::Error Handler - Event Handling Loop.gviweb
diagram:
  w1 = bool TRUE  # Stop Event
  Create User Event[EventName="Stop Event"](user event data type=w1) -> (error out=w2, user event out=w3)
  call "Create All Message Queues.gviweb"(error in=w2) -> (message queues=w4, error out=w5)
  call "Base URL--constant.gvi"() -> (Base URL=w6)
  Property Node(instance in=T1 {all zero or empty}, "BaseURL"=w6) -> (instance out=w7)
  Property Node(instance in=w4) -> ("UI"=w8)
  s1 = w7  # shift register
  while {
    call "Dequeue Message.gviweb"(message queue in=w8, error in=w5) -> (message queue out=w9, message=w10, message data=w11, error out=w12)
    # s1: Data
    # w3: Stop Event
    case (w10) ignore case {  # Message Cases
      frame "Initialize" {
        call "Enqueue Message (Single).gviweb"(message queue in=w9, message="Get Package Details", error in=w12) -> (error out=w13)
        w14 = s1
        w15 = default
      }
      frame "Get Package Details" {
        Property Node(instance in=s1) -> ("BaseURL"=w16, instance out=w17)
        call "SetBusy"(error in=w12) -> (error out=w18)
        call "Open Connection.gvi"(Root URL=w16, error in=w18) -> (Connection=w19, error out=w20)
        call "Get Package Details.gvi"(Connection in=w19, error in=w20) -> (Connection out=w21, Package Details=w22, error out=w23)
        call "Get All Package Versions.gvi"(Connection in=w21, error in=w23) -> (Connection out=w24, All Versions text=w25, error out=w26)
        Property Node(instance in=w17, "Package Details"=w22, "All Versions"=w25) -> (instance out=w14)
        call "Close Connection.gvi"(Connection in=w24, error in=w26) -> (error out=w27)
        call "UnsetBusy"(error in=w27) -> (error out=w28)
        call "Enqueue Message (Single).gviweb"(message queue in=w9, message="Display Package Details", error in=w28) -> (error out=w13)
        w15 = default
      }
      frame "Display Package Details" {
        Property Node(instance in=s1) -> ("Package Details"=w29, instance out=w14)
        Property Node(instance in=w29) -> ("DisplayName"=w30, "IconURL"=w31, "ReleaseDate"=w32, "Vendor"=w33, "Author"=w34, "Description"=w35, "Release Notes"=w36, "Dependencies"=w37)
        $Name <- w30
        $PkgIcon <- w31
        call "JSON Timestamp to Display.gvi"(JSON Timestamp=w32) -> (Display Timestamp=w38)
        $ReleaseDate <- w38
        $Vendor <- w33
        $Author <- w34
        $Description <- w35
        $"Release Notes" <- w36
        call "Join Strings.gvi"(String Array Input=w37, Separator="\r\n") -> (String output=w39)
        $Dependencies <- w39
        call "Enqueue Message (Single).gviweb"(message queue in=w9, message="Display Versions", error in=w12) -> (error out=w13)
        w15 = default
      }
      frame "Display Versions" {
        Property Node(instance in=s1) -> ("All Versions"=w40, "Package Details:Version"=w41, instance out=w14)
        Search 1D Array(1D array=w40, element=w41) -> (index of element=w42)
        Property Node(instance in=reference to "Version", "Items"=w40, "Value"=w42)
        w13 = w12
        w15 = default
      }
      frame "Version changed" {
        Property Node(instance in=s1) -> ("BaseURL"=w43, "Package Details:Name"=w44, "All Versions"=w45, instance out=w14)
        call "SetBusy"(error in=w12) -> (error out=w46)
        call "Open Connection.gvi"(Root URL=w43, error in=w46) -> (Connection=w47, error out=w48)
        Decimal String To Number(string=w11) -> (number=w49)
        Array Index(array=w45) -> (out0[w49]=w50)
        call "Set Package.gvi"(Connection in=w47, Name=w44, Version=w50, error in=w48) -> (Connection out=w51, error out=w52)
        call "Close Connection.gvi"(Connection in=w51, error in=w52) -> (error out=w53)
        call "Enqueue Message (Single).gviweb"(message queue in=w9, message="Get Package Details", error in=w53) -> (error out=w54)
        call "UnsetBusy"(error in=w54) -> (error out=w13)
        w15 = default
      }
      frame "Download Package" {
        Property Node(instance in=s1) -> ("Package Details:PackageURL"=w55, instance out=w14)
        call "SetBusy"(error in=w12) -> (error out=w56)
        call "Redirect"(URL=w55, target="_blank", error in=w56) -> (error out=w57)
        call "UnsetBusy"(error in=w57) -> (error out=w13)
        w15 = default
      }
      frame "Error" {
        # Process Error
        w58 = no error  # Error
        Unflatten From JSON(JSON string=w11, error in (no error)=w12, type and defaults=w58) -> (error out=w13, value=w59)
        call "Read Error Code.gvi"(error in=w59) -> (code=w60)
        case (w60) {
          frame 501401 {
            # Redirect to Login page
            call "Redirect"(URL="Login.html")
          }
          frame 0, Default {
            # Display Error
            call "Error Handler.gvi"(error in=w59)
          }
        }
        w14 = s1
        w15 = default
      }
      frame "---Copy This Frame---" {
        Merge Errors(w12) -> (error out=w13)
        w14 = s1
        w15 = default
      }
      frame "Exit" {
        # Release the message queue reference
        Release Queue(error in=w12, queue=w9) -> (error out=w61)
        Generate User Event(event data=TRUE, user event=w3) -> (error out=w62)
        Merge Errors(w62, w61) -> (error out=w13)
        # Stop the VI
        w14 = s1
        w15 = TRUE
      }
      frame Default {
        w63 = "The invalid message string \"%s\" was received in the Message Handling Loop."
        Format Into String(formatString=w63, w10) -> w64
        call "Build Error Cluster.gvi"(code=1, description=w64) -> (error out=w13)
        w14 = s1
        w15 = default
      }
    }
    call "Error Handler - Message Handling Loop.gviweb"(message queue in=w9, error in=w13) -> (dup error in=w65)
    next s1 = w14
    stop if w15
  }
  Register For Events("Stop Event"=w3) -> (event registration refnum out=w66)
  s2 = w66  # shift register
  while {
    event (dynamic events = s2) {
      on "Dynamic" Stop Event {
        # The Message Handling Loop processed an "Exit" message, which fired this event to stop the Event Handling Loop.
        w67 = TRUE
        w68 = no error
        w69 = w8
      }
      on "Download" Value changed {
        call "Enqueue Message (Single).gviweb"(message queue in=w8, message="Download Package") -> (message queue out=w69, error out=w68)
        w67 = default
      }
      on "Version" Value changed {
        Event Data() -> ("New Value"=w70)
        Number To Decimal String(number=w70) -> (decimal integer string=w71)
        call "Enqueue Message (Single).gviweb"(message queue in=w8, message="Version changed", message data=w71) -> (message queue out=w69)
        w67 = default
        w68 = default
      }
    }
    call "Error Handler - Event Handling Loop.gviweb"(message queue in=w69, error in=w68) -> (dup error in=w72)
    stop if w67
  }
  Unregister For Events(error in=w72, event registration refnum=s2) -> (error out=w73)
  Merge Errors(w73, w65) -> (error out=w74)
  Destroy User Event(error in=w74, user event=w3)
