vi "Packages.gviweb"   [LabVIEW NXG Preview 4.0.0]
# This template is for the Queued Message Handler design pattern. The Event Handling Loop generates messages based on user interface actions. The Message Handling Loop processes messages generated by the Event Handling Loop, or by other messages. The messages are string values, so new messages can be added easily to the Message Cases case structure in the Message Handling Loop. Each message cluster can also provide an optional value for Message Data,  which is a String that can be swapped to whatever type of data is required.
panel controls:
  "Search": string
  "First": bool
  "Previous": bool
  "Next": bool
  "Last": bool
  "Package Details": bool
panel indicators:
  "Tree": cluster{"Element 0": string, "Data": string}[]
  "Status string": string
  "URL Image": string
  "PrototypedBy": string
types:
  "List Packages Settings--cluster.gtype" = cluster{"PageNumber": i32, "SearchCriteria": string}
  "List Details--cluster.gtype" = cluster{"TotalPackages": i32, "TotalPages": i32, "PagesBefore": i32, "PagesAfter": i32, "ItemsPerPage": i32}
  "Package--cluster.gtype" = cluster{"Name": string, "DisplayName": string, "RepoType": string, "RepoName": string, "Versions": "Package Version.gtype"[]}
  T1 = cluster{"BaseURL": string, "Settings": "List Packages Settings--cluster.gtype", "List Details": "List Details--cluster.gtype", "Packages": "Package--cluster.gtype"[], "All Tags": string[], "All Indexes": cluster{"Package": i32, "Version": i32}[]}
uses:
  QMH support::Message Queue::Create All Message Queues.gviweb
  HTTP Client API::Base URL--constant.gvi
  QMH support::Message Queue::Dequeue Message.gviweb
  QMH support::Message Queue::Enqueue Message (Single).gviweb
  BusyStateAPI::BusyStateAPI.jsli::SetBusy
  HTTP Client API::Connection::Open Connection.gvi
  HTTP Client API::Packages::List Packages.gvi
  HTTP Client API::Connection::Close Connection.gvi
  BusyStateAPI::BusyStateAPI.jsli::UnsetBusy
  RedirectURL::Redirect.jsli::Redirect
  WebApp::Support::Format Packages for Tree Display.gvi
  WebApp::Support::Build Status String.gvi
  HTTP Client API::Packages::Set Package.gvi
  NI::G Core::Error::Read Error Code.gvi
  Error Handling::Error Handler.gvi
  NI::G Core::Error::Build Error Cluster.gvi
  QMH support::Error Handler - Message Handling Loop.gviweb
  QMH support::Error Handler - Event Handling Loop.gviweb
diagram:
  w1 = bool TRUE  # Stop Event
  Create User Event[EventName="Stop Event"](user event data type=w1) -> (error out=w2, user event out=w3)
  call "Create All Message Queues.gviweb"(error in=w2) -> (message queues=w4, error out=w5)
  call "Base URL--constant.gvi"() -> (Base URL=w6)
  w7 = T1 {"Settings"={"PageNumber"=1, "SearchCriteria"=""}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}
  Property Node(instance in=w7, "BaseURL"=w6) -> (instance out=w8)
  Property Node(instance in=w4) -> ("UI"=w9)
  s1 = w8  # shift register
  while {
    call "Dequeue Message.gviweb"(message queue in=w9, error in=w5) -> (message queue out=w10, message=w11, message data=w12, error out=w13)
    # s1: Data
    # w3: Stop Event
    case (w11) ignore case {  # Message Cases
      frame "Initialize" {
        Property Node(instance in=reference to "Tree", "ColumnHeaders"=["Name - Version", "Release Date", "Vendor"])
        w17 = "List Packages Settings--cluster.gtype" {"PageNumber"=1, "SearchCriteria"=""}
        Flatten To JSON(anything=w17, error in (no error)=w13) -> (JSON string=w18, error out=w19)
        call "Enqueue Message (Single).gviweb"(message queue in=w10, message="List Packages", message data=w18, error in=w19) -> (error out=w14)
        w15 = s1
        w16 = default
      }
      frame "List Packages" {
        Property Node(instance in=s1) -> ("BaseURL"=w20, instance out=w21)
        w22 = "List Packages Settings--cluster.gtype" {"PageNumber"=1, "SearchCriteria"=""}
        Unflatten From JSON(JSON string=w12, type and defaults=w22) -> (value=w23)
        Property Node(instance in=w23) -> ("PageNumber"=w24, "SearchCriteria"=w25, instance out=w26)
        call "SetBusy"(error in=w13) -> (error out=w27)
        call "Open Connection.gvi"(Root URL=w20, error in=w27) -> (Connection=w28, error out=w29)
        call "List Packages.gvi"(Connection in=w28, PageNumber=w24, SearchCriteria=w25, error in=w29) -> (Connection out=w30, Packages=w31, List Details=w32, error out=w33)
        Property Node(instance in=w21, "Packages"=w31, "List Details"=w32, "Settings"=w26) -> (instance out=w15)
        call "Close Connection.gvi"(Connection in=w30, error in=w33) -> (error out=w34)
        call "UnsetBusy"(error in=w34) -> (error out=w35)
        call "Enqueue Message (Single).gviweb"(message queue in=w10, message="Display Packages List", error in=w35) -> (error out=w14)
        w16 = default
      }
      frame "TestRedirect" {
        call "Redirect"(URL="http://www.google.ca", error in=w13) -> (error out=w14)
        w15 = s1
        w16 = default
      }
      frame "Display Packages List" {
        Property Node(instance in=s1) -> ("Packages"=w36, instance out=w37)
        call "SetBusy"(error in=w13) -> (error out=w38)
        call "Format Packages for Tree Display.gvi"(Packages=w36, error in=w38) -> (Packages Tree=w39, All Tags=w40, All Indexes=w41, error out=w42)
        $Tree <- w39
        Property Node(instance in=w37, "All Tags"=w40, "All Indexes"=w41) -> (instance out=w15)
        call "UnsetBusy"(error in=w42) -> (error out=w43)
        call "Enqueue Message (Single).gviweb"(message queue in=w10, message="Refresh Controls", error in=w43) -> (error out=w14)
        # Force reset scroll position
        Array Index(array=w40) -> (out0[0]=w44)
        Open Tree Item(reference in=reference to "Tree", location=w44) -> (reference out=w45)
        Close Tree Item(reference in=w45, location=w44)
        w16 = default
      }
      frame "Tree Selection Changed" {
        Property Node(instance in=s1) -> ("All Tags"=w46, instance out=w15)
        Match Pattern(regular expression="\\\\", string=w12) -> (offset past match=w47)
        Is Greater Or Equal To 0(x=w47) -> w48
        case (w48) {
          frame False, Default {
            Search 1D Array(1D array=w46, element=w12) -> (index of element=w49)
            Increment(x=w49) -> w50
            Array Index(array=w46) -> (out0[w50]=w51)
            Property Node(instance in=reference to "Tree", "Selection"=w51)
          }
          frame True { }
        }
        call "Enqueue Message (Single).gviweb"(message queue in=w10, message="Refresh Controls", error in=w13) -> (error out=w14)
        w16 = default
      }
      frame "Refresh Controls" {
        Build Array(reference to "First", reference to "Previous", reference to "Next", reference to "Last") -> w52
        Property Node(instance in=s1) -> ("List Details:PagesBefore"=w53, "List Details:PagesAfter"=w54, "Settings"=w55, "List Details"=w56, instance out=w15)
        Is Equal To 0(x=w53) -> w57
        case (w57) {
          frame False, Default {
            w58 = FALSE
            w59 = FALSE
          }
          frame True {
            w58 = TRUE
            w59 = TRUE
          }
        }
        Is Equal To 0(x=w54) -> w60
        case (w60) {
          frame False, Default {
            w61 = FALSE
            w62 = FALSE
          }
          frame True {
            w61 = TRUE
            w62 = TRUE
          }
        }
        Build Array(w58, w59, w61, w62) -> w63
        for {
          w64 = each element of w63
          w65 = each element of w52
          Property Node(instance in=w65, "Disabled"=w64)
        }
        call "Build Status String.gvi"(List Packages Settings=w55, List Details=w56) -> (Status String=w66)
        $"Status string" <- w66
        Property Node(instance in=reference to "Tree") -> ("SelectedData"=w67)
        Property Node(instance in=w67) -> ("Element 0"=w68)
        Match Pattern(regular expression="\\\\", string=w68) -> (offset past match=w69)
        Is Greater Or Equal To 0(x=w69) -> w70
        Not(x=w70) -> w71
        Property Node(instance in=reference to "Package Details", "Disabled"=w71)
        w14 = w13
        w16 = default
      }
      frame "Show Package Details" {
        call "SetBusy"(error in=w13) -> (error out=w72)
        Property Node(instance in=s1) -> ("BaseURL"=w73, "Packages"=w74, "All Indexes"=w75, "All Tags"=w76, instance out=w15)
        call "Open Connection.gvi"(Root URL=w73, error in=w72) -> (Connection=w77, error out=w78)
        Property Node(instance in=reference to "Tree") -> ("SelectedData"=w79)
        Property Node(instance in=w79) -> ("Element 0"=w80)
        Search 1D Array(1D array=w76, element=w80) -> (index of element=w81)
        Array Index(array=w75) -> (out0[w81]=w82)
        Property Node(instance in=w82) -> ("Package"=w83, "Version"=w84)
        Array Index(array=w74) -> (out0[w83]=w85)
        Property Node(instance in=w85) -> ("Name"=w86, "Versions"=w87)
        Array Index(array=w87) -> (out0[w84]=w88)
        Property Node(instance in=w88) -> ("Version Text"=w89)
        call "Set Package.gvi"(Connection in=w77, Name=w86, Version=w89, error in=w78) -> (Connection out=w90, error out=w91)
        call "Close Connection.gvi"(Connection in=w90, error in=w91) -> (error out=w92)
        call "Redirect"(URL="PackageDetails.html", target="_blank", error in=w92) -> (error out=w93)
        call "UnsetBusy"(error in=w93) -> (error out=w14)
        w16 = default
      }
      frame "First" {
        Property Node(instance in=s1) -> ("Settings"=w94, instance out=w15)
        Property Node(instance in=w94, "PageNumber"=1) -> (instance out=w95)
        Flatten To JSON(anything=w95) -> (JSON string=w96)
        call "Enqueue Message (Single).gviweb"(message queue in=w10, message="List Packages", message data=w96, error in=w13) -> (error out=w14)
        w16 = default
      }
      frame "Last" {
        Property Node(instance in=s1) -> ("Settings"=w97, "List Details:TotalPages"=w98, instance out=w15)
        Property Node(instance in=w97, "PageNumber"=w98) -> (instance out=w99)
        Flatten To JSON(anything=w99) -> (JSON string=w100)
        call "Enqueue Message (Single).gviweb"(message queue in=w10, message="List Packages", message data=w100, error in=w13) -> (error out=w14)
        w16 = default
      }
      frame "Previous" {
        Property Node(instance in=s1) -> ("Settings"=w101, "Settings:PageNumber"=w102, instance out=w15)
        Decrement(x=w102) -> w103
        Property Node(instance in=w101, "PageNumber"=w103) -> (instance out=w104)
        Flatten To JSON(anything=w104) -> (JSON string=w105)
        call "Enqueue Message (Single).gviweb"(message queue in=w10, message="List Packages", message data=w105, error in=w13) -> (error out=w14)
        w16 = default
      }
      frame "Next" {
        Property Node(instance in=s1) -> ("Settings"=w106, "Settings:PageNumber"=w107, instance out=w15)
        Increment(x=w107) -> w108
        Property Node(instance in=w106, "PageNumber"=w108) -> (instance out=w109)
        Flatten To JSON(anything=w109) -> (JSON string=w110)
        call "Enqueue Message (Single).gviweb"(message queue in=w10, message="List Packages", message data=w110, error in=w13) -> (error out=w14)
        w16 = default
      }
      frame "Error" {
        # Process Error
        w111 = no error  # Error
        Unflatten From JSON(JSON string=w12, error in (no error)=w13, type and defaults=w111) -> (error out=w14, value=w112)
        call "Read Error Code.gvi"(error in=w112) -> (code=w113)
        case (w113) {
          frame 501401 {
            # Redirect to Login page
            call "Redirect"(URL="Login.html")
          }
          frame 0, Default {
            # Display Error
            call "Error Handler.gvi"(error in=w112)
          }
        }
        w15 = s1
        w16 = default
      }
      frame "---Copy This Frame---" {
        Merge Errors(w13) -> (error out=w14)
        w15 = s1
        w16 = default
      }
      frame "Exit" {
        # Release the message queue reference
        Release Queue(error in=w13, queue=w10) -> (error out=w114)
        Generate User Event(event data=TRUE, user event=w3) -> (error out=w115)
        Merge Errors(w115, w114) -> (error out=w14)
        # Stop the VI
        w15 = s1
        w16 = TRUE
      }
      frame Default {
        w116 = "The invalid message string \"%s\" was received in the Message Handling Loop."
        Format Into String(formatString=w116, w11) -> w117
        call "Build Error Cluster.gvi"(code=1, description=w117) -> (error out=w14)
        w15 = s1
        w16 = default
      }
    }
    call "Error Handler - Message Handling Loop.gviweb"(message queue in=w10, error in=w14) -> (dup error in=w118)
    next s1 = w15
    stop if w16
  }
  Register For Events("Stop Event"=w3) -> (event registration refnum out=w119)
  s2 = w119  # shift register
  while {
    event (dynamic events = s2) {
      on "Dynamic" Stop Event {
        # The Message Handling Loop processed an "Exit" message, which fired this event to stop the Event Handling Loop.
        w120 = TRUE
        w121 = no error
        w122 = w9
      }
      on "Tree" Selection changed {
        Event Data() -> ("NewSelection"=w123)
        call "Enqueue Message (Single).gviweb"(message queue in=w9, message="Tree Selection Changed", message data=w123) -> (message queue out=w122, error out=w121)
        w120 = default
      }
      on "Search" Value changed {
        Event Data() -> ("New Value"=w124)
        w125 = "List Packages Settings--cluster.gtype" {"PageNumber"=1, "SearchCriteria"=""}
        Property Node(instance in=w125, "SearchCriteria"=w124, "PageNumber"=1) -> (instance out=w126)
        Flatten To JSON(anything=w126) -> (JSON string=w127)
        call "Enqueue Message (Single).gviweb"(message queue in=w9, message="List Packages", message data=w127) -> (message queue out=w122, error out=w121)
        w120 = default
      }
      on "First" Value changed {
        call "Enqueue Message (Single).gviweb"(message queue in=w9, message="First") -> (message queue out=w122, error out=w121)
        w120 = default
      }
      on "Last" Value changed {
        call "Enqueue Message (Single).gviweb"(message queue in=w9, message="Last") -> (message queue out=w122, error out=w121)
        w120 = default
      }
      on "Next" Value changed {
        call "Enqueue Message (Single).gviweb"(message queue in=w9, message="Next") -> (message queue out=w122, error out=w121)
        w120 = default
      }
      on "Previous" Value changed {
        call "Enqueue Message (Single).gviweb"(message queue in=w9, message="Previous") -> (message queue out=w122, error out=w121)
        w120 = default
      }
      on "Package Details" Value changed {
        call "Enqueue Message (Single).gviweb"(message queue in=w9, message="Show Package Details") -> (message queue out=w122, error out=w121)
        w120 = default
      }
    }
    call "Error Handler - Event Handling Loop.gviweb"(message queue in=w122, error in=w121) -> (dup error in=w128)
    stop if w120
  }
  Unregister For Events(error in=w128, event registration refnum=s2) -> (error out=w129)
  Merge Errors(w129, w118) -> (error out=w130)
  Destroy User Event(error in=w130, user event=w3)
